# Grasshopper definition allowing-disallowing-modules-based-on-attractor.gh (Grasshopper 1.0.7)
# plug-ins: Monoceros

# Attractor
pt = Point(Point(13.72919765, 8.991645322, 5.804451037))
# Slot centers
pt_2 = Point([Point(2, 2, 2), Point(3, 2, 2), Point(4, 2, 2), Point(5, 2, 2), Point(6, 2, 2), Point(7, 2, 2)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])
# All Modules
M = Module([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])
# "Selected" Module indices
panel = Panel("""1
3""")
dist = Distance(PointA=pt, PointB=pt_2)
# Search distance
smaller = SmallerThan(FirstNumber=dist, SecondNumber=Slider(8.4, range=0..10))  # -> SmallerThan, OrEqualTo
# List of Modules
# without the "selected" Modules
cull_i = CullIndex(List=M, Indices=panel, Wrap=True)
dispatch = Dispatch(List=pt_2, DispatchPattern=smaller.SmallerThan)  # -> ListA, ListB
graft = GraftTree(Tree=dispatch.ListB, IncludeEmptyLists=True, IncludeNullItems=True)
# Points close enought to the attractor
# for Slots allowing placement
# of the "selected" Modules
graft_2 = GraftTree(Tree=dispatch.ListA, IncludeEmptyLists=True, IncludeNullItems=True)
# Slots allowing placement
# of all Modules, including
# the "selected" Modules
slotmodules = ConstructSlotWithListedModulesAllowed(SlotPoint=graft_2, BasePlane=PlaneXY(0, 0, 0), GridSlotDiagonal=Vector(1, 1, 1), AllowedModuleNames=M, Modules=M)
# Slots allowing placement
# of Modules without
# the "selected" Modules
slotmodules_2 = ConstructSlotWithListedModulesAllowed(SlotPoint=graft, BasePlane=PlaneXY(0, 0, 0), GridSlotDiagonal=Vector(1, 1, 1), AllowedModuleNames=cull_i, Modules=M)
merge = Merge(Data1=slotmodules, Data2=slotmodules_2)
flatten = FlattenTree(Tree=merge, Path="{0}")
panel_2 = Panel(flatten)
