# Grasshopper definition allowing-modules-based-on-multiple-attractor-gradients-2-clean-preview.gh (Grasshopper 1.0.7)
# plug-ins: Monoceros

# Slot centers
pt = Point([Point(2, 2, 2), Point(3, 2, 2), Point(4, 2, 2), Point(5, 2, 2), Point(6, 2, 2), Point(7, 2, 2)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])
# Roulette
# Minimum multiplier -
# minimal chance of being chosen.
panel = Panel("0")
# Roulette
# Maximum multiplier -
# maximal chance of being chosen.
number_slider = Slider(10, range=0..100)
# All Modules (Optional)
M = Module([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])
number_slider_2 = Slider(0.7, range=0..1)
dom = ConstructDomain(DomainStart=number_slider, DomainEnd=panel)
# Modules affected
# by the second attractor
panel_2 = Panel("""module-1
module-2""")
# Modules unaffected
# by the attractors
panel_3 = Panel("""module-3
module-4""")
# Modules affected
# by the first attractor
panel_4 = Panel("module-0")
# The second attractor
geo = Geometry(Point(1.776145587, 10.72537657, 12.3293516))
xz = XZPlane(Origin=geo)
# The first attractor
geo_2 = Geometry(Point(12.33554633, 0.5311189528, 3.132507376))
xz_2 = XZPlane(Origin=geo_2)
tag = TextTag3D(
    Location=xz_2,
    Text="Attractor 1",
    Size=number_slider_2,
    Colour=ColourSwatch(SwatchColor=RGB(41, 240, 153)),
    Justification=7)
tag_2 = TextTag3D(
    Location=xz,
    Text="Attractor 2",
    Size=number_slider_2,
    Colour=ColourSwatch(SwatchColor=RGB(240, 41, 84)),
    Justification=7)

# ----
# Roulette
# Multiply Module names
# with a chance of being chose
# based on proximity to the attractor
pull = PullPoint(Point=pt, Geometry=geo_2, ClosestOnly=True)  # -> ClosestPoint, Distance
bnd = Bounds(Numbers=pull.Distance)
remap = RemapNumbers(Value=pull.Distance, Source=bnd, Target=dom)  # -> Mapped, Clipped
dup = DuplicateData(Data=panel_4, Number=remap.Mapped, Order=True)

# ----
# Roulette
pull_2 = PullPoint(Point=pt, Geometry=geo, ClosestOnly=True)  # -> ClosestPoint, Distance
# Roulette
# Multiply unaffected modules
# with maximal chance of being chosen.
bnd_2 = Bounds(Numbers=pull_2.Distance)
remap_2 = RemapNumbers(Value=pull_2.Distance, Source=bnd_2, Target=dom)  # -> Mapped, Clipped
dup_2 = DuplicateData(Data=panel_2, Number=remap_2.Mapped, Order=True)

lng = ListLength(List=pt)
dup_3 = DuplicateData(Data=number_slider, Number=lng, Order=True)  # -> graft(Data)
dup_4 = DuplicateData(Data=panel_3, Number=dup_3, Order=True)

panel_5 = Panel(dup_4)
panel_6 = Panel(dup)
# Roulette
# Multiplied Module names -
# weighted chances of being chosen
merge = Merge(Data1=simplify(dup), Data2=simplify(dup_2), Data3=simplify(dup_4))
# All Modules count
number_slider_3 = Slider(5, range=0..10)
tstat = TreeStatistics(Tree=merge)  # -> Paths, Length, Count
tsort = SortText(Keys=merge, Culture=127)  # -> Keys, Values
subtraction = Subtraction(A=tstat.Length, B=number_slider_3)  # -> graft(Result)
random = Random(Range="10000", Number=tstat.Count, Seed=2)  # -> graft(Random)
panel_7 = Panel(tsort.Keys)
# Roulette
# Randomly choose 5 Module names
# for each Slot.
# Different random seed for each Slot.
reduce = RandomReduce(List=merge, Reduction=subtraction, Seed=random)
# Automatically deduplicates
# Module names.
slotmodules = ConstructSlotWithListedModulesAllowed(SlotPoint=graft(pt), BasePlane=PlaneXY(0, 0, 0), GridSlotDiagonal=Vector(1, 1, 1), AllowedModuleNames=reduce, Modules=M)  # -> flatten(Slot)
panel_8 = Panel(slotmodules)
deconslot = DeconstructSlot(Slot=slotmodules)  # -> Center, BasePlane, Diagonal, AllowedModuleNames, AllowsEverything, AllowsNothing, IsValid
item = ListItem(List=M, Index=Slider(0, range=0..4), Wrap=True)
mn = ModuleName(item)
tmatch = MatchText(Text=deconslot.AllowedModuleNames, Pattern=mn, Case=True)
ma = MassAddition(Input=tmatch)  # -> flatten(Result), PartialResults
cull = CullPattern(List=slotmodules, CullPattern=ma.Result)
