# Grasshopper definition allowing-modules-based-on-vertical-gradient.gh (Grasshopper 1.0.7)
# plug-ins: Monoceros

# Roulette
# Maximum multiplier -
# maximal chance of being chosen.
number_slider = Slider(10, range=0..100)
# Roulette
# Minimum multiplier -
# minimal chance of being chosen.
panel = Panel("0")
dom = ConstructDomain(DomainStart=panel, DomainEnd=number_slider)
dom_2 = ConstructDomain(DomainStart=number_slider, DomainEnd=panel)
# All Modules (Optional)
M = Module([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])
# Slot centers
pt = Point([Point(2, 2, 2), Point(3, 2, 2), Point(4, 2, 2), Point(5, 2, 2), Point(6, 2, 2), Point(7, 2, 2)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])
pdecon = Deconstruct(Point=pt)  # -> XComponent, YComponent, ZComponent
mn = ModuleName(M)
bnd = Bounds(Numbers=pdecon.ZComponent)
remap = RemapNumbers(Value=pdecon.ZComponent, Source=bnd, Target=dom)  # -> Mapped, Clipped
remap_2 = RemapNumbers(Value=pdecon.ZComponent, Source=bnd, Target=dom_2)  # -> Mapped, Clipped
# All Module names
panel_2 = Panel(mn)
dup = DuplicateData(Data="false", Number=remap_2.Mapped, Order=True)
dup_2 = DuplicateData(Data="true", Number=remap.Mapped, Order=True)
merge = Merge(Data1=dup_2, Data2=dup)  # -> simplify(Result)
# Binary roulette
tstat = TreeStatistics(Tree=merge)  # -> Paths, Length, Count
panel_3 = Panel(merge)
# "Selected" Module indices
panel_4 = Panel("""0
1""")
random = Random(Range=Domain(0, 1), Number=tstat.Count, Seed=2)  # -> graft(Random)
# List of Modules
# without the "selected" Modules
cull_i = CullIndex(List=mn, Indices=panel_4, Wrap=True)
remap_3 = RemapNumbers(Value=random, Source=Domain(0, 1), Target=graft(tstat.Length))  # -> Mapped, Clipped
panel_5 = Panel(cull_i)
item = ListItem(List=merge, Index=remap_3.Mapped, Wrap=True)  # -> flatten(Item)
dispatch = Dispatch(List=pt, DispatchPattern=item)  # -> ListA, ListB
graft = GraftTree(Tree=dispatch.ListB, IncludeEmptyLists=True, IncludeNullItems=True)
# Points chosen to contain
# the "selected" Modules
# based on their vertical position
graft_2 = GraftTree(Tree=dispatch.ListA, IncludeEmptyLists=True, IncludeNullItems=True)
panel_6 = Panel(item)
# Slots allowing placement
# of Modules without
# the "selected" Modules
slotmodules = ConstructSlotWithListedModulesAllowed(SlotPoint=graft, BasePlane=PlaneXY(0, 0, 0), GridSlotDiagonal=Vector(1, 1, 1), AllowedModuleNames=cull_i, Modules=M)
# Slots allowing placement
# of all Modules, including
# the "selected" Modules
slotmodules_2 = ConstructSlotWithListedModulesAllowed(SlotPoint=graft_2, BasePlane=PlaneXY(0, 0, 0), GridSlotDiagonal=Vector(1, 1, 1), AllowedModuleNames=mn, Modules=M)
merge_2 = Merge(Data1=slotmodules_2, Data2=slotmodules)
flatten = FlattenTree(Tree=merge_2, Path="{0}")
panel_7 = Panel(flatten)
