# Grasshopper definition allowing-modules-to-be-at-the-boundary-of-the-envelope.gh (Grasshopper 1.0.7)
# plug-ins: Bifocals, Monoceros

geo = Geometry(<curve referenced from the Rhino model>)
geo_2 = Geometry(<curve referenced from the Rhino model>)
slice = SliceGeometry(Geometry=geo_2, BasePlane=PlaneXY(0, 0, 0), GridSlotDiagonal=Vector(1, 1, 1), FillMethod=2, Precision=0.5)
slice_2 = SliceGeometry(Geometry=geo, BasePlane=PlaneXY(0, 0, 0), GridSlotDiagonal=Vector(1, 1, 1), FillMethod=2, Precision=0.5)
constmodule = ConstructModule(
    Name="allowed-on-boundary",
    ModulePartPoints=slice,
    ProductionGeometry=geo_2,
    BasePlane=PlaneXY(0, 0, 0),
    ModulePartDiagonal=Vector(1, 1, 1))
constmodule_2 = ConstructModule(
    Name="disallowed-on-boundary",
    ModulePartPoints=slice_2,
    ProductionGeometry=geo,
    BasePlane=PlaneXY(0, 0, 0),
    ModulePartDiagonal=Vector(1, 1, 1))
merge = Merge(Data1=constmodule, Data2=constmodule_2)
pt = Point([<point referenced from the Rhino model> x4])
pt_2 = Point([<point referenced from the Rhino model> x2])
ruletyppt = TypedRuleFromPoint(Modules=merge, PointTag=pt, ConnectorType="connection")  # -> flatten(Rules)
ruleboundpt = RuleAtBoundaryFromPoint(Modules=merge, PointTag=pt_2)  # -> flatten(Rules)
panel = Panel(ruletyppt)
panel_2 = Panel(ruleboundpt)
