# Grasshopper definition disallowing-rules.gh (Grasshopper 1.0.7)
# plug-ins: Monoceros

panel = Panel("""module-1:0 = type-a
module-2:3 = type-a
module-3:3 = type-a""")
M = Module([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])
collectrules = CollectRules(Modules=M, RulesAllowed=panel, ExplicitRulesDisallowed="module-1:0 -> module-3:3")
panel_2 = Panel(collectrules)
