# Grasshopper definition empty-module-and-additional-explicit-rules.gh (Grasshopper 1.0.7)
# plug-ins: Monoceros

# ---- group: All Modules
moduleempty = ConstructEmptyModule(BasePlane="{2,-2,0}", ModulePartDiagonal=Vector(1, 1, 1))  # -> Module, Rules
M = Module([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])
merge = Merge(Data1=M, Data2=moduleempty.Module)

# ----
R = Rule([{IsExplicit=True, IsTyped=False, SourceConnectorIndex=0, SourceModuleName="module-0", TargetConnectorIndex=3, TargetModuleName="module-1"}, {ConnectorIndex=1, ConnectorType="type-a", IsExplicit=False, IsTyped=True, ModuleName="module-0"}, {ConnectorIndex=4, ConnectorType="type-a", IsExplicit=False, IsTyped=True, ModuleName="module-1"}])
crv = Curve(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)
panel = Panel(R)
ruleexpcrv = ExplicitRuleFromCurve(Modules=merge, ConnectionCurve=crv)

# ---- group: All manually assigned Rules
merge_2 = Merge(Data1=moduleempty.Rules, Data2=R, Data3=ruleexpcrv)  # -> flatten(Result)

# ----
panel_2 = Panel(ruleexpcrv)
ruleindiffunused = IndifferentRulesForUnusedConnectors(Module=merge, Rules=merge_2)  # -> flatten(Rules)

# ---- group: All Rules
merge_3 = Merge(Data1=ruleindiffunused, Data2=merge_2)

# ----
panel_3 = Panel(merge_3)
