# Grasshopper definition enforcing-specific-modules-at-the-boundary-of-the-envelope-multiple-2.gh (Grasshopper 1.0.7)
# plug-ins: Monoceros

# Modules
# with round corners
# for the internal layers of Slots
panel = Panel("{-4, 0 , 0}")
# 9 layers of Slots
number_slider = Slider(2, range=0..10)
# Modules with sharpest corners
# for the outermost boundary
# layer of Slots
M = Module([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])
# Modules with sharp corners
# for the second boundary
# layer of Slots
M_2 = Module([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])
M_3 = Module([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])
S = Slot([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])
# Curves defining Rules
crv = Curve([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])
areslotsbound = AreSlotsBoundary(Slots=S, Layers=number_slider)
moduleempty = ConstructEmptyModule(BasePlane=panel, ModulePartDiagonal="{1, 1, 0.25}")  # -> Module, Rules
merge = Merge(Data1=M, Data2=moduleempty.Module)  # -> flatten(Result)
merge_2 = Merge(Data1=M_2, Data2=moduleempty.Module)  # -> flatten(Result)
merge_3 = Merge(Data1=M_3, Data2=moduleempty.Module)  # -> flatten(Result)
merge_4 = Merge(Data1=M, Data2=M_2, Data3=M_3, Data4=moduleempty.Module)  # -> flatten(Result)
ruleexpcrv = ExplicitRuleFromCurve(Modules=merge_4, ConnectionCurve=crv)  # -> flatten(Rules)
dispatch = Dispatch(List=S, DispatchPattern=areslotsbound)  # -> ListA, ListB
slotmodules = ConstructSlotWithListedModulesAllowed(
    SlotPoint=dispatch.ListA,
    BasePlane=PlaneXY(0, 0, 0),
    GridSlotDiagonal="{1, 1, 0.25}",
    AllowedModuleNames=flatten(merge),
    Modules=merge_4)
ruleindiffunused = IndifferentRulesForUnusedConnectors(Module=merge_4, Rules=ruleexpcrv)  # -> flatten(Rules)
areslotsbound_2 = AreSlotsBoundary(Slots=dispatch.ListB, Layers=Slider(2, range=0..10))
dispatch_2 = Dispatch(List=dispatch.ListB, DispatchPattern=areslotsbound_2)  # -> ListA, ListB
merge_5 = Merge(Data1=moduleempty.Rules, Data2=ruleexpcrv, Data3=ruleindiffunused)  # -> flatten(Result)
slotmodules_2 = ConstructSlotWithListedModulesAllowed(
    SlotPoint=dispatch_2.ListA,
    BasePlane=PlaneXY(0, 0, 0),
    GridSlotDiagonal="{1, 1, 0.25}",
    AllowedModuleNames=flatten(merge_2),
    Modules=[merge_4, merge_2])
slotmodules_3 = ConstructSlotWithListedModulesAllowed(
    SlotPoint=dispatch_2.ListB,
    BasePlane=PlaneXY(0, 0, 0),
    GridSlotDiagonal="{1, 1, 0.25}",
    AllowedModuleNames=flatten([merge_3, merge_2, merge]),
    Modules=merge_4)
# Only pick the central layer of Slots
# because the four bottom and top layers
# cosist entirely of boundary Slots
merge_6 = Merge(Data1=slotmodules, Data2=slotmodules_2, Data3=slotmodules_3)  # -> flatten(Result)
deconslot = DeconstructSlot(Slot=merge_6)  # -> Center, BasePlane, Diagonal, AllowedModuleNames, IsDeterministic, AllowsAllModules, AllowsNothing, IsValid
pdecon = Deconstruct(Point=deconslot.Center)  # -> XComponent, YComponent, ZComponent
bnd = Bounds(Numbers=flatten(pdecon.ZComponent))
remap = RemapNumbers(Value="0.5", Source=Domain(0, 1), Target=bnd)  # -> Mapped, Clipped
equals = Equality(FirstNumber=pdecon.ZComponent, SecondNumber=remap.Mapped)  # -> flatten(Equality), Inequality
cull = CullPattern(List=merge_6, CullPattern=equals.Equality)
S_2 = Slot(cull)
M_4 = Module(merge_4)
R = Rule(merge_5)
int = Integer(101344671)
wfc = MonocerosWFCSolver(
    Slots=S_2,
    Modules=M_4,
    Rules=R,
    RandomSeed=int,
    MaxAttempts=Slider(500, range=0..1000),
    MaxObservations=2147483647,
    MaxTime=0,
    UseShannonEntropy=False)  # -> Out, Slots, Deterministic, Contradictory, Seed, Attempts, Observations
materialize = MaterializeSlots(Module=M_4, Slots=wfc.Slots)  # -> Geometry, Transform
