# Grasshopper definition explicit-rule-from-components.gh (Grasshopper 1.0.7)
# plug-ins: Monoceros

ruleexp = ConstructExplicitRule(
    SourceModule="module_a",
    SourceConnectorIndex=Slider(1, range=0..10),
    TargetModule="module_b",
    TargetConnectorIndex=Slider(4, range=0..10))
panel = Panel(ruleexp)
