# Grasshopper definition explicit-rule-from-curve.gh (Grasshopper 1.0.7)
# plug-ins: Monoceros

crv = Curve(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)
M = Module(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)
ruleexpcrv = ExplicitRuleFromCurve(Modules=M, ConnectionCurve=crv)
panel = Panel(ruleexpcrv)
