# Grasshopper definition growing-the-boundary-of-the-envelope.gh (Grasshopper 1.0.7)
# plug-ins: Monoceros

S = Slot([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])
addslotbound = AddBoundaryLayer(Slots=S, Layers=Slider(2, range=0..10))
slotall = ConstructSlotWithAllModulesAllowed(SlotPoint=addslotbound, BasePlane=PlaneXY(0, 0, 0), GridSlotDiagonal=Vector(1, 1, 1))
merge = Merge(Data1=flatten(S), Data2=flatten(slotall))
