# Grasshopper definition module-part-points-created-manually-from-geometry.gh (Grasshopper 1.0.7)
# plug-ins: Monoceros

crv = Curve(<curve referenced from the Rhino model>)
divide = DivideCurve(Curve=crv, Count=Slider(20, range=0..100), Kinks=False)  # -> Points, Tangents, Parameters
constmodule = ConstructModule(Name="module", ModulePartPoints=divide.Points, BasePlane=PlaneXY(0, 0, 0), ModulePartDiagonal=Vector(1, 1, 1))
