# Grasshopper definition module-part-points-created-with-slice-geometry.gh (Grasshopper 1.0.7)
# plug-ins: Monoceros

crv = Curve(<curve referenced from the Rhino model>)
slice = SliceGeometry(Geometry=crv, BasePlane=PlaneXY(0, 0, 0), GridSlotDiagonal="{1,1,1}", FillMethod=2, Precision=0.5)
constmodule = ConstructModule(Name="module", ModulePartPoints=slice, BasePlane=PlaneXY(0, 0, 0), ModulePartDiagonal="{1,1,1}")
