# Grasshopper definition roulette-choosing-a-binary-weighted-option.gh (Grasshopper 1.0.7)

panel = Panel("""true
false""")
merge = Merge(Data1=Slider(3, range=0..10), Data2=Slider(2, range=0..10))
graft = GraftTree(Tree=panel, IncludeEmptyLists=True, IncludeNullItems=True)
graft_2 = GraftTree(Tree=merge, IncludeEmptyLists=True, IncludeNullItems=True)
dup = DuplicateData(Data=graft, Number=graft_2, Order=True)
flatten = FlattenTree(Tree=dup, Path="{0}")
lng = ListLength(List=flatten)
panel_2 = Panel(flatten)
subtraction = Subtraction(A=lng, B="1")
reduce = RandomReduce(List=flatten, Reduction=subtraction, Seed=Slider(515447, range=0..1000000))
panel_3 = Panel(reduce)
