# Grasshopper definition roulette-choosing-more-weighted-options-from-multiple-choices.gh (Grasshopper 1.0.7)
# plug-ins: Bifocals

genes = GenePool(Decimals=2, Maximum=1, Minimum=0, Value=[0.3, 0.1, 0.8])
panel = Panel("""a
b
c""")
multiplication = Multiplication(A=genes, B="10")
graft = GraftTree(Tree=panel, IncludeEmptyLists=True, IncludeNullItems=True)
graft_2 = GraftTree(Tree=multiplication, IncludeEmptyLists=True, IncludeNullItems=True)
dup = DuplicateData(Data=graft, Number=graft_2, Order=True)
lng = ListLength(List=panel)
flatten = FlattenTree(Tree=dup, Path="{0}")
lng_2 = ListLength(List=flatten)
panel_2 = Panel(flatten)
subtraction = Subtraction(A=lng_2, B=lng)
reduce = RandomReduce(List=flatten, Reduction=subtraction, Seed=Slider(478311, range=0..1000000))
cset = CreateSet(List=reduce)  # -> Set, Map
panel_3 = Panel(reduce)
tsort = SortText(Keys=cset.Set, Culture=127)  # -> Keys, Values
panel_4 = Panel(tsort.Keys)
