# Grasshopper definition roulette-choosing-one-weighted-option-from-multiple-choices.gh (Grasshopper 1.0.7)

genes = GenePool(Decimals=2, Maximum=1, Minimum=0, Value=[0.3, 0.1, 0.8])
panel = Panel("""a
b
c""")
multiplication = Multiplication(A=genes, B="10")
graft = GraftTree(Tree=panel, IncludeEmptyLists=True, IncludeNullItems=True)
graft_2 = GraftTree(Tree=multiplication, IncludeEmptyLists=True, IncludeNullItems=True)
dup = DuplicateData(Data=graft, Number=graft_2, Order=True)
flatten = FlattenTree(Tree=dup, Path="{0}")
lng = ListLength(List=flatten)
panel_2 = Panel(flatten)
subtraction = Subtraction(A=lng, B="1")
reduce = RandomReduce(List=flatten, Reduction=subtraction, Seed=Slider(544573, range=0..1000000))
panel_3 = Panel(reduce)
