# Grasshopper definition slots-from-manually-generated-points.gh (Grasshopper 1.0.7)
# plug-ins: Monoceros

number_slider = Slider(1.5, range=0..10)
number_slider_2 = Slider(2, range=0..10)
number_slider_3 = Slider(2.5, range=0..10)
series = Series(Start=0, Step=number_slider, Count=Slider(5, range=0..10))
series_2 = Series(Start=0, Step=number_slider_2, Count=Slider(6, range=0..10))
series_3 = Series(Start=0, Step=number_slider_3, Count=Slider(7, range=0..10))
crossref = CrossReference(ListA=series, ListB=series_2, ListC=series_3, CrossMode=1)  # -> ListA, ListB, ListC
pt = ConstructPoint(XCoordinate=crossref.ListA, YCoordinate=crossref.ListB, ZCoordinate=crossref.ListC)
vec = VectorXYZ(XComponent=number_slider, YComponent=number_slider_2, ZComponent=number_slider_3)  # -> Vector, Length
slotall = ConstructSlotWithAllModulesAllowed(SlotPoint=pt, BasePlane=PlaneXY(0, 0, 0), GridSlotDiagonal=vec.Vector)
