# Grasshopper definition slots-from-slice-geometry-curves.gh (Grasshopper 1.0.7)
# plug-ins: Bifocals, Monoceros

vec = VectorXYZ(XComponent=Slider(1.5, range=0..10), YComponent=Slider(2, range=0..10), ZComponent=Slider(0.5, range=0..10))  # -> Vector, Length
crv = Curve([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])
slice = SliceGeometry(Geometry=crv, BasePlane=PlaneXY(0, 0, 0), GridSlotDiagonal=vec.Vector, FillMethod=2, Precision=Slider(0.25, range=0..1))
slotall = ConstructSlotWithAllModulesAllowed(SlotPoint=slice, BasePlane=PlaneXY(0, 0, 0), GridSlotDiagonal=vec.Vector)
