# Grasshopper definition slots-from-slice-geometry-mesh-and-brep-volumes.gh (Grasshopper 1.0.7)
# plug-ins: Monoceros

mesh = Mesh(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)
brep = Brep(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)
vec = VectorXYZ(XComponent=Slider(1, range=0..10), YComponent=Slider(1, range=0..10), ZComponent=Slider(1, range=0..10))  # -> Vector, Length
merge = Merge(Data1=brep, Data2=mesh)
slice = SliceGeometry(
    Geometry=merge,
    BasePlane=PlaneXY(0, 0, 0),
    GridSlotDiagonal=vec.Vector,
    FillMethod=Slider(0, range=0..3),
    Precision=Slider(0.25, range=0..1))
viewer = ParamViewer(slice)
slotall = ConstructSlotWithAllModulesAllowed(SlotPoint=slice, BasePlane=PlaneXY(0, 0, 0), GridSlotDiagonal=vec.Vector)
