# Grasshopper definition slots-from-slice-geometry-miscellaneous-geometry.gh (Grasshopper 1.0.7)
# plug-ins: Monoceros

srf = Surface(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)
crv = Curve([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])
brep = Brep(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)
mesh = Mesh(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)
pt = Point([Point(2.486685842, 1.107439772, 0.9340213597), Point(8.75821514, 7.961442879, 0.4404517982), Point(0.960044973, 9.516898365, 0.9651758973), Point(9.142282707, 0.9184793154, 1.504984329), Point(4.419897676, 6.225770733, 1.422511779), Point(9.71759215, 4.613409189, 1.807313576)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])
vec = VectorXYZ(XComponent=Slider(1, range=0..10), YComponent=Slider(1.5, range=0..10), ZComponent=Slider(2, range=0..10))  # -> Vector, Length
merge = Merge(Data1=pt, Data2=srf, Data3=crv, Data4=brep, Data5=mesh)  # -> flatten(Result)
slice = SliceGeometry(
    Geometry=merge,
    BasePlane=PlaneXY(0, 0, 0),
    GridSlotDiagonal=vec.Vector,
    FillMethod=Slider(2, range=0..3),
    Precision=Slider(0.25, range=0..1))
slotall = ConstructSlotWithAllModulesAllowed(SlotPoint=slice, BasePlane=PlaneXY(0, 0, 0), GridSlotDiagonal=vec.Vector)
