# Grasshopper definition slots-from-slice-geometry-points.gh (Grasshopper 1.0.7)
# plug-ins: Monoceros

vec = VectorXYZ(XComponent=Slider(1.5, range=0..10), YComponent=Slider(2, range=0..10), ZComponent=Slider(2.5, range=0..10))  # -> Vector, Length
pt = Point([Point(2.486685842, 1.107439772, 0.9340213597), Point(8.75821514, 7.961442879, 0.4404517982), Point(0.960044973, 9.516898365, 0.9651758973), Point(9.142282707, 0.9184793154, 1.504984329), Point(4.419897676, 6.225770733, 1.422511779), Point(9.71759215, 4.613409189, 1.807313576)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])
slice = SliceGeometry(Geometry=pt, BasePlane=PlaneXY(0, 0, 0), GridSlotDiagonal=vec.Vector, FillMethod=2, Precision=0.5)
slotall = ConstructSlotWithAllModulesAllowed(SlotPoint=slice, BasePlane=PlaneXY(0, 0, 0), GridSlotDiagonal=vec.Vector)
