# Grasshopper definition slots-from-slice-geometry-surfaces.gh (Grasshopper 1.0.7)
# plug-ins: Monoceros

vec = VectorXYZ(XComponent=Slider(1.5, range=0..10), YComponent=Slider(2, range=0..10), ZComponent=Slider(2.5, range=0..10))  # -> Vector, Length
srf = Surface(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)
slice = SliceGeometry(Geometry=srf, BasePlane=PlaneXY(0, 0, 0), GridSlotDiagonal=vec.Vector, FillMethod=2, Precision=Slider(0.25, range=0..1))
slotall = ConstructSlotWithAllModulesAllowed(SlotPoint=slice, BasePlane=PlaneXY(0, 0, 0), GridSlotDiagonal=vec.Vector)
