# Grasshopper definition typed-rule-from-components.gh (Grasshopper 1.0.7)
# plug-ins: Monoceros

ruletyp = ConstructTypedRule(ModuleName="module", ConnectorIndex=Slider(4, range=0..10), Type="type_b")
panel = Panel(ruletyp)
